# Grasshopper definition principal_curvature.gh (Grasshopper 1.0.7)

srf = Surface(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)
python = GhPythonScript(surface=srf, uDiv=Slider(8, range=0..100), vDiv=Slider(10, range=0..100))  # -> out, uCurves, vCurves, intersection; inputs surface: Surface, uDiv: Int32, vDiv: Int32
# ---------- python: Python ----------
__author__ = "you-wei"

import Rhino.Geometry as rg
import rhinoscriptsyntax as rs

#Select Surface for principal curvature
#Get points on surface for measurement

#Domain
domain = rg.Interval(0,1)
surface.SetDomain(0, domain)
surface.SetDomain(1, domain)

#Isocurve extraction
uCurves = []
vCurves = []
for u in range(uDiv+1):
    uCurve = surface.IsoCurve(1, u/uDiv)
    uCurves.append(uCurve)

for v in range(vDiv+1):
    vCurve = surface.IsoCurve(0, v/vDiv)
    vCurves.append(vCurve)

#Intersect Points
intersection = []
for u in range(uDiv+1):
    for v in range(vDiv+1):
        intersect = surface.PointAt(u/uDiv,v/vDiv)
        intersection.append(intersect)

#U,V points
U = []
V = []
for i in range(intersection.Count):
    a,u,v = surface.ClosestPoint(intersection[i])
    U.append(u)
    V.append(v)

#Principal curvature
for i in range(U.Count):
    srfcrv = rs.SurfaceCurvature(surface,(U[i],V[i]))


    point, normal, kappa_u, direction_u, kappa_v, direction_v, gaussian, mean = srfcrv

    print "Surface curvature evaluation at parameter: ({0}, {1})".format(U[i],V[i])
    print "  3-D Point: ({0}, {1}, {2})".format(point.X, point.Y, point.Z)
    print "  3-D Normal: ({0}, {1}, {2})".format(normal.X, normal.Y, normal.Z)
    print "  Maximum principal curvature: {0} ({1}, {2}, {3})".format(kappa_u, direction_u.X, direction_u.Y, direction_u.Z)
    print "  Minimum principal curvature: {0} ({1}, {2}, {3})".format(kappa_v, direction_v.X, direction_v.Y, direction_v.Z)
    print "  Gaussian curvature: {0}".format(gaussian)
    print "  Mean curvature: {0}".format(mean)
# ---------- end python ----------
crv = Curve(python.vCurves)
crv_2 = Curve(python.uCurves)
pt = Point(python.intersection)
srf_cp = SurfaceCP(Point=pt, Surface=srf)  # -> Point, UVPoint, Distance
angle = Slider(0, range=-90..90)
panel = Panel("""True
False""")
rad = Radians(Degrees=angle)

python_2 = GhPythonScript(srf=srf, uv=srf_cp.UVPoint, accuracy=Slider(1, range=0..10), angle=rad, max=graft(panel))  # -> out, samples; inputs srf: Surface, uv: Point3d, max: Boolean
# ---------- python_2: Python ----------
"""
modified from VB script by David Rutten uploaded on 
grasshopper forum: principal-curvature-lines-on
"""

import Rhino.Geometry as rg
import math

p = uv
U = srf.Domain(0)
V = srf.Domain(1)


def PrincipalCurvature(srf, uv, accuracy, max, angle):
    while True:
        #Abort if we've added more than 10,000 samples
        if (samples.Count > 10000):
            break
        #Get the curvature at the current point
        crv = srf.CurvatureAt(p.X,p.Y)
        if (crv is None) :
            break
        #Add the current point
        samples.append(srf.PointAt(p.X, p.Y))
        #Get the maximum principal direction
        if (crv.Kappa(0) > crv.Kappa(1)):
            if (max):
                dir = crv.Direction(0)
            else:
                dir = crv.Direction(1)
        else:
            if (max):
                dir = crv.Direction(1)
            else:
                dir = crv.Direction(0)
        dir.Rotate(angle, crv.Normal)
        if (not dir.IsValid):
            break
        if (not dir.Unitize()):
            break
        #Scale the direction vector to match our accuracy
        dir *= accuracy
        #Flip the direction 180 degrees if it seems to be going backwards
        N = samples.Count
        if (N > 1) :
            if ( dir.IsParallelTo(samples[N - 1] - samples[N - 2], 0.5 * math.pi) < 0 ) :
                dir.Reverse()
        #Move the last point in the list along the curvature direction
        pt = samples[samples.Count - 1] + dir
        a,s,t = srf.ClosestPoint(pt)
        #Abort if we've wandered beyond the surface edge
        if (not U.IncludesParameter(s, True)):
            break
        if (not V.IncludesParameter(t, True)):
            break
        #Abort if the new point is basically the same as the old point
        if (abs(p.X - s) < 1e-12)  and (abs(p.Y - t) < 1e-12):
            break
        p.X = s
        p.Y = t

samples = []
PrincipalCurvature(srf, uv, accuracy, max, angle)
#PrincipalCurvature(srf, uv, accuracy, max, angle + math.pi)
# ---------- end python_2 ----------
pline = PolyLine(Vertices=python_2.samples, Closed=False)
